# Grasshopper definition layoutTesting.gh (Grasshopper 1.0.7)

numstories = Slider(3, range=1..5)
storyheight = Slider(10, range=0..10)
corridorwidth = Slider(6, range=0..100)
leg2 = Slider(0, range=0..1)
leg3 = Slider(0, range=0..1)
leg_1 = Slider(0, range=0..1)
number_slider = Slider(210, range=0..1000)
number_slider_2 = Slider(210, range=0..1000)
unitdepth = Slider(27, range=0..100)
multiplication = Multiplication(A=unitdepth, B=2)
main = Slider(1, range=0..1)
addition = Addition(A=multiplication, B=corridorwidth)
multiplication_2 = Multiplication(A=numstories, B=storyheight)
rectangle = Rectangle(Plane=PlaneXY(0, 0, 0), XSize=number_slider_2, YSize=number_slider, Radius=0)  # -> Rectangle, Length
crv = Curve(rectangle.Rectangle)
cp = ControlPoints(Curve=crv)  # -> Points, Weights, Knots
item = ListItem(List=cp.Points, Index=0, Wrap=True)

multiplication_3 = Multiplication(A=unitdepth, B=2)
subtraction = Subtraction(A=number_slider_2, B=multiplication_3)
multiplication_4 = Multiplication(A=subtraction, B=main)
vec = VectorXYZ(XComponent=unitdepth, YComponent=unitdepth, ZComponent=0)  # -> Vector, Length
X = UnitX(Factor=multiplication_4)
move = Move(Geometry=item, Motion=vec.Vector)  # -> Geometry, Transform
move_2 = Move(Geometry=move.Geometry, Motion=X)  # -> Geometry, Transform
ln = Line(StartPoint=move.Geometry, EndPoint=move_2.Geometry)

subtraction_2 = Subtraction(A=number_slider, B=multiplication_3)
multiplication_5 = Multiplication(A=subtraction_2, B=leg_1)
Y = UnitY(Factor=multiplication_5)
move_3 = Move(Geometry=move.Geometry, Motion=Y)  # -> Geometry, Transform
ln_2 = Line(StartPoint=move.Geometry, EndPoint=move_3.Geometry)

len = Length(Curve=ln)
c_script = CSharpScript(height=multiplication_2, width=addition, primaryLength=len, legTwoRatio=leg2, legThreeRatio=leg3)  # -> legTwo, legThree; inputs height: Double, width: Double, primaryLength: Double
# ---------- c_script: C# ----------
    if((primaryLength - width) > height)
    {
      legThree = legThreeRatio;
    }
    else
    {
      legThree = 0;
    }

    if(primaryLength - 2 * width > height)
    {
      legTwo = legTwoRatio;
    }
    else
    {
      legTwo = 0;
    }
# ---------- end c_script ----------

multiplication_6 = Multiplication(A=subtraction_2, B=c_script.legThree)
Y_2 = UnitY(Factor=multiplication_6)
len_2 = Length(Curve=ln)
X_2 = UnitX(Factor=len_2)
move_4 = Move(Geometry=move.Geometry, Motion=Y_2)  # -> Geometry, Transform
move_5 = Move(Geometry=move_4.Geometry, Motion=X_2)  # -> Geometry, Transform
move_6 = Move(Geometry=move.Geometry, Motion=X_2)  # -> Geometry, Transform
ln_3 = Line(StartPoint=move_6.Geometry, EndPoint=move_5.Geometry)

len_3 = Length(Curve=ln)
multiplication_7 = Multiplication(A=subtraction_2, B=c_script.legTwo)
division = Division(A=len_3, B=2)
Y_3 = UnitY(Factor=multiplication_7)
move_7 = Move(Geometry=move.Geometry, Motion=Y_3)  # -> Geometry, Transform
X_3 = UnitX(Factor=division)
move_8 = Move(Geometry=move_7.Geometry, Motion=X_3)  # -> Geometry, Transform
move_9 = Move(Geometry=move.Geometry, Motion=X_3)  # -> Geometry, Transform
ln_4 = Line(StartPoint=move_9.Geometry, EndPoint=move_8.Geometry)

merge = Merge(Data1=ln, Data2=ln_2, Data3=ln_4, Data4=ln_3)
c_script_2 = CSharpScript(x=merge)  # -> A; inputs x: Line
# ---------- c_script_2: C# ----------
    if(x.Length!=0)
    {
      A = x;
    }
# ---------- end c_script_2 ----------
division_2 = Division(A=corridorwidth, B=2)
neg = Negative(Value=division_2)
merge_2 = Merge(Data1=division_2, Data2=neg)
clean = CleanTree(RemoveNulls=True, RemoveInvalid=True, RemoveEmpty=False, Tree=c_script_2)
offset = OffsetCurve(Curve=clean, Distance=simplify(graft(merge_2)), Plane=PlaneXY(0, 0, 0), Corners=1)  # -> simplify(Curve)
